% Simulink data dictionary controllerParams.sldd

guidanceParams = Simulink.Parameter(struct(phiCmd_rad=0, thetaCmd_rad=0, psiCmd_rad=0))

outerLoopParams = Simulink.Parameter(struct(
  upRateLimitPitchYawRate_rps2=0.5,
  loRateLimitPitchYawRate_rps2=-0.5,
  upLimitPitchYawRate_rps=0.4,
  loLimitPitchYawRate_rps=-0.4,
  pitchYawGains=[2 1 0 1],
  upRateLimitRollRate_rps2=5,
  loRateLimitRollRate_rps2=-5,
  upLimitRollRate_rps=2,
  loLimitRollRate_rps=-2,
  rollGains=[1 2 0 100]))

innerLoopParams = Simulink.Parameter(struct(
  upRateLimitPitchYaw_dps=180,
  loRateLimitPitchYaw_dps=-180,
  upLimitPitchYaw_deg=45,
  loLimitPitchYaw_deg=-45,
  upRateLimitRoll_dps=90,
  loRateLimitRoll_dps=-90,
  upLimitRoll_deg=5,
  loLimitRoll_deg=-5,
  fbkGainBreakpoints_Pa=[0 30000 75000],
  fbkPitchYawGamma_na=[1 0 0 0; 0 1 0 0; 0 0 1 0; 0 0 0 1],
  fbkPitchYawLambda_na=0.9990005,
  fbkPitchYawTheta0_na=[1 1 -100 100],
  fbkPitchRefTau_na=0.9990005,
  omegaBias_na=0.1,
  fbkGainRollP_na=[2.75 2.625 2.5],
  fbkGainRollI_na=[20 12 10],
  fbkGainRollD_na=[0 0 0],
  fbkGainRollN_na=[1 1 1]))