% Simulink data dictionary plantParams.sldd

vehicleParams = Simulink.Parameter(struct(mass_kg=18, area_m2=0.018, inertia_kgm2=[8.41 0 0; 0 8.41 0; 0 0 0.053], momentArm_m=[0.384 0 0]))
icParams = Simulink.Parameter(struct(velBdy_mps=[150 10 0], eul_rad=[0 1.570796 0], rateBdy_rps=[1 0 0], posNed_m=[0 0 0]))
envParams = Simulink.Parameter(struct(gravityNed_mps2=[0 0 9.81], lon_deg=-87.67671, lat_deg=42.05694, groundAlt_m=182, date_y=2026.666))

aeroParams = Simulink.Parameter(struct(
  cnBreakpoints_na=[-1 -0.9 -0.8 -0.7 -0.6 -0.5 -0.4 -0.3 -0.2 -0.1 0 0.1 0.2 0.3 0.4 0.5 0.6 0.7 0.8 0.9 1],
  cnTable_na=[-8.41471 -7.833269 -7.173561 -6.442177 -5.646425 -4.794255 -3.894183 -2.955202 -1.986693 -0.9983342 0 0.9983342 1.986693 2.955202 3.894183 4.794255 5.646425 6.442177 7.173561 7.833269 8.41471],
  cdBreakpoints_na=[-1 -0.9 -0.8 -0.7 -0.6 -0.5 -0.4 -0.3 -0.2 -0.1 0 0.1 0.2 0.3 0.4 0.5 0.6 0.7 0.8 0.9 1],
  cdTable_na=repmat(0.5, 1, 21)))

sensorParams = Simulink.Parameter(struct(
  imuPosBdy_m=[0 0 0],
  accScaleCoupling_na=[1 0 0; 0 1 0; 0 0 1],
  accPSDWhite=[5.413280625e-7 5.413280625e-7 5.413280625e-7],
  accTau_s=200,
  accSigmaBias_mps2=[0.001962 0.001962 0.001962],
  accPSDGM=[3.849444e-08 3.849444e-08 3.849444e-08],
  accSigmaBiasTurnOn_mps2=[0.004905 0.004905 0.004905],
  accSampleTime_s=0.01,
  gyroScaleCoupling_na=[1 0 0; 0 1 0; 0 0 1],
  gyroPSDWhite=[3.730155625e-5 3.730155625e-5 3.730155625e-5],
  gyroTau_s=200,
  gyroSigmaBias_rps=[2.424e-5 2.424e-5 2.424e-5],
  gyroPSDGM=[5.875776e-12 5.875776e-12 5.875776e-12],
  gyroSigmaBiasTurnOn_rps=[0.0005 0.0005 0.0005],
  gyroSampleTime_s=0.01,
  gyroG=[0.0171123425 0 0; 0 0.0171123425 0; 0 0 0.0171123425],
  magSI=[1.08 0.05 -0.03; 0.04 0.93 0.02; -0.03 0.02 1.05],
  magBiasHIBdy_nT=[1200 -800 500],
  magPSDWhite=[196 196 196],
  magSampleTime_s=0.01,
  baroPSDWhite=0.0004,
  baroBiasTurnOn_Pa=40,
  baroTau_s=500,
  baroPSDGM=0.144,
  baroSampleTime_s=0.01))